vi "Index.gviweb"   [LabVIEW NXG 5.0.0]
panel controls:
  "Pi (cmH2O)": u32 = 15
  "MODE": enum{"V A/C", "P A/C", "PSV", "VSIMV", "PSIMV"} = "P A/C"
  "PEEP (cmH2O)": f64 = 5
  "Rate": f64 = 13
  "Start": bool
  "Rise Time": f64 = 2
  "Insp. Time": f64 = 1.5
  "I Sense": f64 = 3
  "Vt Target": f64 = 400
  "PauseAL": bool
  "Freeze Graphs": bool
  "Edit and Apply": bool
  "URL": string = "http://127.0.0.1:8001/WebService1/"
  "Rate_2": f64 = 13
  "PIP (cmH2O)": f64 = 5
  "Set Alarm": bool
  "Back to Ventilation_4": bool
  "Alarm": bool
  "Reports": bool
  "Pi (cmH2O)_2": f64 = 15
  "EDIT MODE_2": enum{"V A/C", "P A/C", "PSV", "VSIMV", "PSIMV"} = "P A/C"
  "PEEP (cmH2O)_2": f64 = 5
  "Rate_5": f64 = 13
  "Start_2": bool
  "Rise Time_2": f64 = 2
  "Insp. Time_2": f64 = 1.5
  "I Sense_2": f64 = 3
  "Vt Target_2": f64 = 400
  "Change Mode_2": bool
  "Rate_6": f64 = 13
  "Alarm_3": bool
  "Waveform_2": bool
  "Preference_2": bool
  "Setup_2": bool
  "PIP (cmH2O)_13": f64 = 5
  "PIP (cmH2O)_14": f64 = 5
  "PIP (cmH2O)_15": f64 = 5
  "PIP (cmH2O)_16": f64
  "PIP (cmH2O)_17": f64 = 5
  "PIP (cmH2O)_18": f64 = 5
  "PIP (cmH2O)_19": f64 = 5
  "PIP (cmH2O)_20": f64
  "PIP (cmH2O)_21": f64 = 5
  "PIP (cmH2O)_22": f64 = 5
  "PIP (cmH2O)_23": f64 = 5
  "PIP (cmH2O)_24": f64
  "Ventilation_7": bool
  "Alarm Log_2": bool
  "PressureChart_2": f64[]
  "FlowChart_2": f64[]
  "VolumeChart_2": f64[]
  "Freeze Graphs_2": bool
  "Ventilation_8": bool
  "Date_2": string = "27-08-2020"
  "Time_2": string = "11:50:55"
  "Machine Hour_2": string
  "Patient Hour_2": string = "1:30:88"
  "Pressure Settings_2": enum{"RELATIVE", "ABSOLUTE"} = "RELATIVE"
  "Reset Patient Hour_2": bool
  "Ventilation_9": bool
  "Maintanance_2": bool
  "Calibration_2": bool
  "Ventilation Report_2": i32 = -1
  "Pediatric Circuite_2": enum{"YES", "NO"} = "YES"
  "Apnea Alarm_2": enum{"YES", "NO"} = "YES"
  "Ventilation_10": bool
  "Patient Pressure_2": cluster{"Slope(M)": f64, "Intercept(c)": f64} = {"Slope(M)"=5, "Intercept(c)"=5}
  "Insp Valve Pressure_2": cluster{"Slope(M)": f64, "Intercept(c)": f64} = {"Slope(M)"=5, "Intercept(c)"=5}
  "Insp Flow_2": cluster{"Slope(M)": f64, "Intercept(c)": f64} = {"Slope(M)"=5, "Intercept(c)"=5}
  "Exhalation flow_2": cluster{"Slope(M)": f64, "Intercept(c)": f64} = {"Slope(M)"=5, "Intercept(c)"=5}
  "Fio2_2": cluster{"Slope(M)": f64, "Intercept(c)": f64} = {"Slope(M)"=5, "Intercept(c)"=5}
  "Ventilation_11": bool
  "Fault Check list_2": i32 = -1
  "Software Version No_2": string = "3455X776"
  "Serial No_2": string = "3465546"
  "Turbine Speed Test_2": string
  "Rate_7": f64 = 13
  "UP_2": bool
  "Down_2": bool
  "Max_2": bool
  "Altitude Settinds_2": enum{"YES", "NO"} = "YES"
  "Rate_8": f64 = 13
  "Ventilation_12": bool
  "Alarm Log List_2": i32 = -1
  "Alarm_4": bool
  "Export report": bool
  "timeout": i32 = 100
  "PIP (cmH2O)_3": f64 = 5
  "PIP (cmH2O)_4": f64 = 5
  "PIP (cmH2O)_6": f64 = 5
  "PIP (cmH2O)_9": f64 = 5
  "PIP (cmH2O)_10": f64 = 5
  "PIP (cmH2O)_11": f64 = 5
  "PIP (cmH2O)_12": f64 = 5
  "Switch": bool
  "Alarm Log": bool
  "Back to Ventilation": bool
  "Button": bool
  "Button_2": bool
  "Prompt": bool = TRUE
  "prompt message": string = "This is a simple prompt!"
  "prompt default": string = "one nice default"
panel indicators:
  "VtI (mL)": f64
  "VtE (mL)": f64
  "M Vol (L)": f64
  "Rate (bpm)": f64
  "I": f64
  "FiO2 (%)": f64
  "E": f64
  "Active Mode": string
  "Pressure": string
  "Last Alarm": string
  "PressureChart": f64
  "FlowChart": f64
  "Post value": cluster{"Acknowledged": bool}
  "PIP (cmH2O)_2": f64
  "Alarm Log List": i32
  "PIP": f64
  "PEEP": f64
  "Current": f64
  "Ventilation time": string
  "Date": string
  "Vte": string
  "Vti": string
  "Spontaneous Breath": string
  "Paw": string
  "Apnea Ti": string
  "Rate_3": string
  "Machine Hour": string
  "Patient Hour": string
  "Status_2": string
  "Get body": string
  "Current_2": f64
  "Tab_2": i32
  "PIP (cmH2O)_5": f64
  "PIP (cmH2O)_7": f64
  "PIP (cmH2O)_8": f64
  "Tab_3": i32
  "Status_3": string
  "prompt value": string
  "prompt cancelled?": bool
  "URL Image_2": string
  "URL Image_3": string
types:
  T1 = cluster{"M Vol (L)": f64, "VtI (mL)": f64, "Rate (bpm)": f64, "E": f64, "cmH2O": f64, "VtE (mL)": f64, "Pressure": f64[], "Flow": f64[], "Volume": f64[]}
  T2 = cluster{"Rate": f64, "Insp. Time": f64, "Pi (cmH2O)": f64, "PEEP (cmH2O)": f64, "Vt Target": f64}
uses:
  NI::HTTP::GET.gvi
  NI::HTTP::POST Buffer.gvi
  SweetAlert::Prompt.gvi
diagram:
  Build Array(reference to "Set Alarm", reference to "Reports", reference to "Edit and Apply", reference to "MODE") -> w1
  Build Array(reference to "Start", reference to "Edit and Apply") -> w2
  for {
    w3 = each element of w2
    Property Node(instance in=w3, "Value"=FALSE) -> (error out=w4)
  }
  Build Array(reference to "Vt Target", reference to "Pi (cmH2O)", reference to "Insp. Time", reference to "Rise Time", reference to "Rate", reference to "I Sense", reference to "PEEP (cmH2O)", reference to "Rate_2") -> w5
  Property Node(instance in=reference to "Tab_2", "Value"=0) -> (instance out=w6)
  w7 = $URL
  s1 = w6  # shift register
  s2 = uninitialised  # shift register
  while {
    # s2: Activate value
    # w5: Ref_LabelChange
    # w7: URL
    # w1: Ref_UI data_disable
    event (timeout = 200) {
      on "Timeout" {
        Concatenate Strings(w7, "General") -> w10
        call "GET.gvi"(timeout=$timeout, url=w10, error in=w4) -> (body=w11, error out=w12)
        # This loop recieve the data defined in the "Unflatten From Json" from the contoller the controller.taking data
        # in a dutaion defined in the time out constant of event structure.
        # Make sure the name is defined in the Unflatter From Json matches with the names we defined in webservice
        $"Get body" <- w11
        Unflatten From Json(JSON string=w11, error in (no error)=w12, type and defaults=T1 {all zero or empty}) -> (value=w13)
        Property Node(instance in=w13) -> ("M Vol (L)"=w14, "VtI (mL)"=w15, "Rate (bpm)"=w16, "E"=w17, "VtE (mL)"=w18, "Pressure"=w19, "Flow"=w20, "Volume"=w21)
        $"M Vol (L)" <- w14
        $"VtI (mL)" <- w15
        $"Rate (bpm)" <- w16
        $E <- w17
        Random Number() -> (number (0 to 1)=w22)
        Multiply(w22, 10) -> w23
        case ($"Freeze Graphs") {
          frame True { }
          frame False {
            $PressureChart <- w23
            $FlowChart <- w23
          }
        }
        $"VtE (mL)" <- w18
        disable {
          frame Enabled { }
          frame Disabled {
            Property Node(instance in=cluster{"HMI": u16} {all zero or empty}, "HMI"=$MODE) -> (instance out=w24)
            Flatten To Json(anything=w24) -> (JSON string=w25, error out=w26)
          }
        }
        w8 = s1
        w9 = s2
      }
      on "Insp. Time" Value changed; "PEEP (cmH2O)" Value changed; "Pi (cmH2O)" Value changed; "Rate" Value changed; "Vt Target" Value changed {
        Concatenate Strings(w7, "UpdatePara") -> w27
        Property Node(instance in=T2 {all zero or empty}, "Rate"=$Rate, "Insp. Time"=$"Insp. Time", "Pi (cmH2O)"=$"Pi (cmH2O)", "PEEP (cmH2O)"=$"PEEP (cmH2O)", "Vt Target"=$"Vt Target") -> (instance out=w28)
        Flatten To Json(anything=w28, error in (no error)=w4) -> (JSON string=w29, error out=w30)
        call "POST Buffer.gvi"(url=w27, buffer=w29, error in=w30, timeout=100) -> (body=w31, error out=w32)
        Unflatten From Json(JSON string=w31, error in (no error)=w32, type and defaults=cluster{"Acknowledged": bool} {all zero or empty}) -> (value=w33)
        $"Post value" <- w33
        w8 = s1
        w9 = s2
      }
      on "Start" Value changed {
        Event Data() -> ("New Value"=w9, "Control Reference"=w34)
        case (w9) {
          frame False {
            for {
              w36 = each element of w5
              Property Node(instance in=w36, "Disabled"=FALSE)
            }
            Build Array("Activate") -> w37
            Property Node(instance in=w34, "Text"=w37)
            for {
              w38 = each element of w1
              w39 = each element of [FALSE, FALSE, FALSE, FALSE]
              Property Node(instance in=w38, "Disabled"=w39)
            }
            Property Node(instance in=reference to "MODE", "Disabled"=FALSE)
            w35 = "-"
          }
          frame True {
            for {
              w40 = each element of w5
              Property Node(instance in=w40, "Disabled"=TRUE)
            }
            Build Array("Stand by") -> w41
            Property Node(instance in=w34, "Text"=w41)
            for {
              w42 = each element of w1
              w43 = each element of [FALSE, FALSE, FALSE, TRUE]
              Property Node(instance in=w42, "Disabled"=w43)
            }
            Property Node(instance in=reference to "MODE") -> ("Value"=w44)
            Format Into String(w44) -> w35
            Property Node(instance in=reference to "MODE", "Disabled"=TRUE)
          }
        }
        $"Active Mode" <- w35
        w8 = s1
      }
      on "Set Alarm" Value changed; "Alarm Log" Value changed; "Alarm" Value changed; "Back to Ventilation" Value changed; "Back to Ventilation_4" Value changed; "Reports" Value changed {
        Event Data() -> ("Control Reference"=w45)
        Property Node(instance in=w45) -> ("Text"=w46)
        Array Index(array=w46) -> (out0[0]=w47)
        case (w47) {
          frame "Set Alarm" {
            w48 = 1
          }
          frame "Alarm Log" {
            w48 = 2
          }
          frame "Alarm" {
            w48 = 1
          }
          frame "Back to Ventilation", "Back to Ventilation_4", Default {
            w48 = 0
          }
          frame "Reports" {
            w48 = 3
          }
        }
        Property Node(instance in=s1, "Value"=w48) -> (instance out=w8)
        w9 = s2
      }
      on "MODE" Value changed {
        case (s2) {
          frame True {
            Property Node(instance in=reference to "Edit and Apply", "Disabled"=FALSE)
          }
          frame False {
            Property Node(instance in=reference to "Edit and Apply", "Disabled"=TRUE)
          }
        }
        Event Data() -> ("New Value"=w49)
        case (w49) {
          frame "V A/C", Default {
            w51 = ["Vt", "PIP", "Insp Time", "Ramp Pattern", "Rate", "I Sense", "NA", "NA"]
            w50 = w51
          }
          frame "P A/C" {
            w52 = ["Pi (cmH2O)", "PEEP", "Rise time", "Insp time", "Rate", "I Sense", "NA", "NA"]
            w50 = w52
          }
          frame "PSV" {
            w53 = ["P support", "PEEP", "Rise time", "Min I time", "Max I time", "I Sense", "E Sense", "Apnea time"]
            w50 = w53
          }
          frame "VSIMV" {
            w54 = ["Vt", "PEEP", "Rise time", "P support", "Rate", "I Sense", "E Sense", "Insp time"]
            w50 = w54
          }
          frame "PSIMV" {
            w55 = ["Pi", "PEEP", "Rise time", "P support", "Rate", "I Sense", "E Sense", "Insp time"]
            w50 = w55
          }
        }
        for {
          w56 = each element of w50
          w57 = each element of w5
          Property Node(instance in=w57) -> ("Label"=w58)
          Property Node(instance in=w58, "Text"=w56)
        }
        w8 = s1
        w9 = s2
      }
      on "Edit and Apply" Value changed {
        Event Data() -> ("Control Reference"=w59, "New Value"=w60)
        case (w60) {
          frame True {
            for {
              w61 = each element of w5
              Property Node(instance in=w61, "Disabled"=FALSE)
            }
            Build Array("Apply") -> w62
            Property Node(instance in=w59, "Text"=w62)
            Property Node(instance in=reference to "MODE", "Disabled"=FALSE)
          }
          frame False {
            for {
              w63 = each element of w5
              Property Node(instance in=w63, "Disabled"=TRUE)
            }
            Build Array("Edit") -> w64
            Property Node(instance in=w59, "Text"=w64)
            Property Node(instance in=reference to "MODE", "Disabled"=TRUE)
            Property Node(instance in=reference to "MODE") -> ("Value"=w65)
            Format Into String(w65) -> w66
            Property Node(instance in=reference to "Active Mode", "Value"=w66)
          }
        }
        w8 = s1
        w9 = s2
      }
      on "Prompt" Value changed {
        call "Prompt.gvi"(message=$"prompt message", default=$"prompt default") -> (value=w67, cancelled?=w68)
        $"prompt value" <- w67
        $"prompt cancelled?" <- w68
        w8 = s1
        w9 = s2
      }
      on "Button_2" Value changed {
        Event Data() -> ("New Value"=w69)
        Select(s=w69, t=1, f=0) -> w70
        $Tab_3 <- w70
        w8 = s1
        w9 = default
      }
    }
    next s1 = w8
    next s2 = w9
    stop if FALSE
  }
  for {
    w71 = each element of w1
    w72 = each element of [FALSE, FALSE, FALSE, FALSE, FALSE]
    Property Node(instance in=w71, "Disabled"=w72)
  }
